# Grasshopper definition auditorium_sightlines.gh (Grasshopper 1.0.7)

ghpython_script = GhPythonScript()  # -> out, a
# ---------- ghpython_script: Python ----------
import math
import random
import Rhino.Geometry as rg
import Rhino.RhinoDoc as rc
import rhinoscriptsyntax as rs
import ghpythonlib.components as gh


class Point:
    def __init__(self, x, y, z):
        self._x = x
        self._y = y
        self._z = z
        self.coordinate = self.get_coordinate()
        
    def get_coordinate(self):
        return  {'x':self._x, 'y':self._y, 'z':self._z}
        
    def generate_point(self):
        x, y, z = self.coordinate.values()        
        return rs.AddPoint(x,y,z)
        
a = Point(50,50,50).generate_point()
# ---------- end ghpython_script ----------
