# Grasshopper definition minimal_surface.gh (Grasshopper 1.0.7)

number_slider = Slider(50, range=0..100)

number_slider_2 = Slider(0.5, range=0..1)
square_root = SquareRoot(Value="2")
square_root_2 = SquareRoot(Value="3")
subtraction = Subtraction(A=1, B=number_slider_2)
division = Division(A=2, B=square_root_2)
multiplication = Multiplication(A=number_slider_2, B=division)
multiplication_2 = Multiplication(A=square_root, B=subtraction)
subtraction_2 = Subtraction(A=1, B=multiplication)
multiplication_3 = Multiplication(A=subtraction_2, B=square_root_2)
subtraction_3 = Subtraction(A=1, B=multiplication_3)

domain_box = DomainBox(Base=PlaneXY(0, 0, 0), X=number_slider, Y=number_slider, Z=number_slider)
deconstruct_brep = DeconstructBrep(Brep=domain_box)  # -> Faces, Edges, Vertices
list_item = ListItem(List=deconstruct_brep.Vertices, Index=2, Wrap=True)
list_item_2 = ListItem(List=deconstruct_brep.Vertices, Index=1, Wrap=True)
list_item_3 = ListItem(List=deconstruct_brep.Vertices, Index=5, Wrap=True)
list_item_4 = ListItem(List=deconstruct_brep.Vertices, Index=4, Wrap=True)
line = Line(StartPoint=list_item, EndPoint=list_item_4)
line_2 = Line(StartPoint=list_item_2, EndPoint=list_item_4)
curve_middle = CurveMiddle(Curve=line)
curve_middle_2 = CurveMiddle(Curve=line_2)

# ---- group: Pt Inside
point = Point(curve_middle)

# ---- group: Pt Mid
point_2 = Point(curve_middle_2)

# ---- group: Pt B
point_3 = Point(list_item_3)

# ---- group: Pt A
point_4 = Point(list_item_4)

# ---- group: box frame
curve = Curve(deconstruct_brep.Edges)

# ----
line_3 = Line(StartPoint=point_4, EndPoint=point_2)
line_4 = Line(StartPoint=point_3, EndPoint=point_4)
line_5 = Line(StartPoint=point_2, EndPoint=point)
line_6 = Line(StartPoint=point_3, EndPoint=point)
evaluate_length = EvaluateLength(Curve=line_5, Length=subtraction_3, Normalized=True)  # -> Point, Tangent, Parameter
evaluate_length_2 = EvaluateLength(Curve=line_6, Length=multiplication_2, Normalized=True)  # -> Point, Tangent, Parameter
evaluate_length_3 = EvaluateLength(Curve=line_3, Length=multiplication_2, Normalized=True)  # -> Point, Tangent, Parameter
evaluate_length_4 = EvaluateLength(Curve=line_4, Length=number_slider_2, Normalized=True)  # -> Point, Tangent, Parameter
vector_2pt = Vector2Pt(PointA=point_2, PointB=point_4, Unitize=False)  # -> Vector, Length
vector_2pt_2 = Vector2Pt(PointA=point, PointB=point_2, Unitize=False)  # -> Vector, Length
plane_3pt = Plane3Pt(PointA=point_2, PointB=point_4, PointC=point)
vector_2pt_3 = Vector2Pt(PointA=point_3, PointB=point_4, Unitize=False)  # -> Vector, Length
plane_3pt_2 = Plane3Pt(PointA=point_2, PointB=point_3, PointC=point)
plane_3pt_3 = Plane3Pt(PointA=point_4, PointB=point_3, PointC=point)
vector_2pt_4 = Vector2Pt(PointA=point_3, PointB=point_4, Unitize=False)  # -> Vector, Length
plane_3pt_4 = Plane3Pt(PointA=point_2, PointB=point_4, PointC=point_3)
vector_2pt_5 = Vector2Pt(PointA=point, PointB=point_2, Unitize=False)  # -> Vector, Length
pi = Pi(Factor=1)
pi_2 = Pi(Factor=1)
plane_origin = PlaneOrigin(Base=plane_3pt, Origin=evaluate_length_3.Point)
plane_origin_2 = PlaneOrigin(Base=plane_3pt_2, Origin=evaluate_length.Point)
plane_origin_3 = PlaneOrigin(Base=plane_3pt_3, Origin=evaluate_length_2.Point)
pi_3 = Pi(Factor=1)
plane_origin_4 = PlaneOrigin(Base=plane_3pt_4, Origin=evaluate_length_4.Point)
division_2 = Division(A=pi, B=-2)
division_3 = Division(A=pi_2, B=2)
pi_4 = Pi(Factor=1)
division_4 = Division(A=pi_3, B=-2)
pi_5 = Pi(Factor=1)
rotate = Rotate(Vector=vector_2pt_2.Vector, Axis=plane_origin_2, Angle=division_3)
rotate_2 = Rotate(Vector=vector_2pt_3.Vector, Axis=plane_origin_4, Angle=division_2)
rotate_3 = Rotate(Vector=vector_2pt_4.Vector, Axis=plane_origin_3, Angle=division_4)
division_5 = Division(A=pi_4, B=2)
division_6 = Division(A=pi_5, B=-2)
rotate_4 = Rotate(Vector=vector_2pt.Vector, Axis=plane_origin, Angle=division_5)
rotate_5 = Rotate(Vector=vector_2pt_5.Vector, Axis=plane_origin, Angle=division_6)
biarc = BiArc(
    StartPoint=evaluate_length_3.Point,
    StartTangent=rotate_4,
    EndPoint=evaluate_length.Point,
    EndTangent=rotate_5,
    Ratio=0.5)  # -> FirstArc, SecondArc, BiArc
arc_sed = ArcSED(Start=evaluate_length.Point, End=evaluate_length_2.Point, Direction=rotate)  # -> Arc, Plane, Radius
arc_sed_2 = ArcSED(Start=evaluate_length_4.Point, End=evaluate_length_2.Point, Direction=rotate_3)  # -> Arc, Plane, Radius
arc_sed_3 = ArcSED(Start=evaluate_length_4.Point, End=evaluate_length_3.Point, Direction=rotate_2)  # -> Arc, Plane, Radius
edge_surface = EdgeSurface(CurveA=biarc.FirstArc, CurveB=arc_sed.Arc, CurveC=arc_sed_2.Arc, CurveD=arc_sed_3.Arc)
