# Grasshopper definition tower_crane_layout.gh (Grasshopper 1.0.7)

# ---- group: map
curve = Curve([<curve referenced from the Rhino model> x3361])

# ---- group: Parameters
gene_pool = GenePool(Decimals=3, Maximum=1, Minimum=0, Value=[0.311, 0.448])
gene_pool_2 = GenePool(Decimals=3, Maximum=1, Minimum=0, Value=[0.679, 0.449])
gene_pool_3 = GenePool(Decimals=0, Maximum=8, Minimum=3, Value=[5, 7])

# ----
point = Point([Point(47.380641, -93.92993675, 0), Point(78.20447733, -0.5216876691, 0), Point(-25.69332507, 12.72318455, 0), Point(-173.511686, -36.31673635, 0), Point(-130.5950383, -105.2598378, 0)])
point_2 = Point([Point(-65.16457828, 44.16003214, 0), Point(-72.43590306, 0.9624069951, 0), Point(-128.3584437, -109.7966134, 0), Point(135.8991132, -187.0877802, 0), Point(147.2518184, -148.2561684, 0), Point(45.82789272, 17.8030161, 0)])
polyline = PolyLine(Vertices=point_2, Closed=True)
number_slider = Slider(0.242, range=0..1)
number_slider_2 = Slider(0.394, range=0..1)
number_slider_3 = Slider(0.547, range=0..1)
number_slider_4 = Slider(0.784, range=0..1)
number_slider_5 = Slider(0.566, range=0..1)
number_slider_6 = Slider(0.56, range=0..1)
# Tower Crane Radius = 80m
curve_2 = Curve(<curve referenced from the Rhino model>)
ghpython_script = GhPythonScript(size=gene_pool_3)  # -> crane_size_1, crane_size_2; inputs size: list of Int32
# ---------- ghpython_script: Python ----------
import math
import random
import Rhino.Geometry as rg
import Rhino.RhinoDoc as rc
import rhinoscriptsyntax as rs
import ghpythonlib.components as gh

def size_scaling(x):
    return x*10
    
if __name__ == "__main__":
    crane_size_1 = size_scaling(size[0])
    crane_size_2 = size_scaling(size[1])
# ---------- end ghpython_script ----------
construct_point = ConstructPoint(XCoordinate=number_slider, YCoordinate=number_slider_2, ZCoordinate=0)
construct_point_2 = ConstructPoint(XCoordinate=number_slider_4, YCoordinate=number_slider_3, ZCoordinate=0)
construct_point_3 = ConstructPoint(XCoordinate=number_slider_5, YCoordinate=number_slider_6, ZCoordinate=0)

# ---- group: site
curve_3 = Curve(<curve referenced from the Rhino model>)

# ----
boundary_surfaces = BoundarySurfaces(Edges=curve_2)
ghpython_script_2 = GhPythonScript(
    site=curve_3,
    crane_size_1=ghpython_script.crane_size_1,
    crane_size_2=ghpython_script.crane_size_2,
    crane_position_1=gene_pool,
    crane_position_2=gene_pool_2)  # -> out, site_surface, crane_origin_1, crane_tower_1, crane_origin_2, crane_tower_2; inputs site: Polyline, crane_size_1: Int32, crane_position_1: list, crane_position_2: list
# ---------- ghpython_script_2: Python ----------
import math
import random
import Rhino.Geometry as rg
import Rhino.RhinoDoc as rc
import rhinoscriptsyntax as rs
import ghpythonlib.components as gh

class Point:
    def __init__(self, position):
        self.x = position[0]
        self.y = position[1]
        self.z = position[2]
        self.coord = self.coordinate_point()
        self.point = self.generate_point()
        
    def coordinate_point(self):
        return self.x, self.y, self.z
        
    def generate_point(self):
        return rs.AddPoint(self.coord[0], self.coord[1], self.coord[2])


class Circle(Point):
    def __init__(self, position, radius):
        Point.__init__(self, position)
        self.radius = radius
        
    def generate_circle(self):
        return rs.AddCircle(self.point, self.radius)


class Surface:
    def __init__(self, polyline):
        self.polyline = self.evaluate_type(polyline)
        self.surface = self.generate_surface()
            
    def generate_surface(self):
        return rs.AddPlanarSrf(self.polyline)[0]
        
    def evaluate_surface(self, position):
        srf_parameter = rs.SurfaceParameter(self.surface, position)
        crane_origin = rs.EvaluateSurface(self.surface, srf_parameter[0], srf_parameter[1])
        return crane_origin
        
    def evaluate_type(self, surface):
        if type(surface) != type(rs.AddPoint(0,0,0)):
            return rs.MoveObject(surface, [0,0,0])
        else:
            return surface
            
    def area_surface(self):
        return rs.SurfaceArea(self.surface)[0]



if __name__ == "__main__":
    site_object = Surface(site)
    site_surface = site_object.generate_surface()
    site_area = site_object.area_surface()
    print(site_area)
    crane_origin_1 = site_object.evaluate_surface(crane_position_1)
    crane_origin_2 = site_object.evaluate_surface(crane_position_2)
    
    crane_tower_1 = Circle(crane_origin_1, crane_size_1).generate_circle()
    crane_tower_2 = Circle(crane_origin_2, crane_size_2).generate_circle()
# ---------- end ghpython_script_2 ----------
evaluate_surface = EvaluateSurface(Surface=reparameterize(boundary_surfaces), Point=construct_point)  # -> Point, Normal, UDirection, VDirection, Frame
evaluate_surface_2 = EvaluateSurface(Surface=reparameterize(boundary_surfaces), Point=construct_point_2)  # -> Point, Normal, UDirection, VDirection, Frame
evaluate_surface_3 = EvaluateSurface(Surface=reparameterize(boundary_surfaces), Point=construct_point_3)  # -> Point, Normal, UDirection, VDirection, Frame
point_3 = Point(evaluate_surface.Point)
point_4 = Point(evaluate_surface_2.Point)
point_5 = Point(evaluate_surface_3.Point)
circle = Circle(Plane=point_3, Radius=50)
circle_2 = Circle(Plane=point_4, Radius=50)
circle_3 = Circle(Plane=point_5, Radius=50)
region_intersection = RegionIntersection(CurvesA=boundary_surfaces, CurvesB=circle)
region_intersection_2 = RegionIntersection(CurvesA=boundary_surfaces, CurvesB=circle_2)
region_intersection_3 = RegionIntersection(CurvesA=boundary_surfaces, CurvesB=circle_3)
region_union = RegionUnion(Curves=[region_intersection, region_intersection_2, region_intersection_3])  # -> flatten(Result)
region_intersection_4 = RegionIntersection(CurvesA=region_intersection, CurvesB=region_intersection_2)
region_intersection_5 = RegionIntersection(CurvesA=region_intersection, CurvesB=region_intersection_3)
region_intersection_6 = RegionIntersection(CurvesA=region_intersection_2, CurvesB=region_intersection_3)
area = Area(Geometry=curve_2)  # -> Area, Centroid
area_2 = Area(Geometry=region_union)  # -> Area, Centroid
subtraction = Subtraction(A=area.Area, B=area_2.Area)
area_3 = Area(Geometry=region_intersection_4)  # -> Area, Centroid
area_4 = Area(Geometry=region_intersection_5)  # -> Area, Centroid
area_5 = Area(Geometry=region_intersection_6)  # -> Area, Centroid
galapagos = Galapagos(
    fitness=number,
    gene=[number_slider, number_slider_2, number_slider_4, number_slider_3, number_slider_5, number_slider_6])
number = Number(subtraction)
addition = Addition(A=subtraction, B=area_3.Area, C=area_4.Area, D=area_5.Area)
panel = Panel(subtraction)
number_2 = Number(addition)
panel_2 = Panel(number_2)
