# Grasshopper definition xmas_tree.gh (Grasshopper 1.0.7)

frame = Slider(100, range=0..100)

# ---- group: points_cloud_tree
file_path = FilePath("C:\BACKUP\Playdata\202105_lab\02.git\toyProject\xmas_tree\data\tree_coords.csv")
ghpython_script = GhPythonScript(tree_coord=file_path)  # -> out, tree
# ---------- ghpython_script: Python ----------
import math
import random
import Rhino.Geometry as rg
import Rhino.RhinoDoc as rc
import rhinoscriptsyntax as rs
import ghpythonlib.components as gh

with open(tree_coord, "r") as coords:
    tree = []
    for coord in coords.readlines()[1:]:
        c = coord.split(',')
        c[3] = c[3].replace('\n', '')
        
        id, x, y, z = list(map(float, c))
        tree_point = rg.Point3d(x, y, z)
        tree.append(tree_point)
# ---------- end ghpython_script ----------

# ----
file_path_2 = FilePath("C:\BACKUP\Playdata\202105_lab\02.git\toyProject\xmas_tree\data\moving-z-plane.csv")
ghpython_script_2 = GhPythonScript(CSV=file_path_2, frame=frame)  # -> out, test; inputs frame: Int32
# ---------- ghpython_script_2: Python ----------
import math
import random
import Rhino.Geometry as rg
import Rhino.RhinoDoc as rc
import rhinoscriptsyntax as rs
import ghpythonlib.components as gh

with open(CSV, 'r') as csv:
    print(csv.readlines()[frame+1])
# ---------- end ghpython_script_2 ----------
panel = Panel(ghpython_script_2.out)
